# Grasshopper definition installer.gh (Grasshopper 1.0.7)

# ----
# 1
toggle = BooleanToggle(False)

# ----
# 2
toggle_2 = BooleanToggle(False)

lbsetup = LBSetupPython(setup_python=toggle)  # -> next_steps; plug-in component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
lbinstall = LBInstaller(install=toggle_2)  # -> Vviiiiiz; plug-in component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
panel = Panel(lbinstall)

# ----
# Follow these instructions
panel_2 = Panel(lbsetup)
